# Grasshopper definition ifckit-components.gh (Grasshopper 1.0.8)

ifckit_build_json = IfckitBuildJSON()  # -> out, json_out; inputs json_input: list of String, project_name: String, author: String, unit: String, ifc_version: String
# ---------- ifckit_build_json: Python ----------
import sys as _sys
_src_dir = r'/Users/Mauc/L140-py-ifckit/grasshopper/src'
if _src_dir not in _sys.path:
    _sys.path.insert(0, _src_dir)
del _sys, _src_dir

import json
import ifckit_reload  # noqa: F401 — sets sys.path and reloads all of ifckit

out = ""
json_out = ""

if not json_input:
    out = "ERROR: no JSON input."
else:
    try:
        _project_name = str(project_name) if project_name else "GH Project"
        _author = str(author) if author else "GH"
        _unit = str(unit).upper() if unit else "MILLIMETRE"
        _ifc_version = str(ifc_version).upper() if ifc_version else "IFC2X3"

        inputs = json_input if isinstance(json_input, list) else [json_input]

        storeys_out = []
        total = 0

        for item in inputs:
            s = str(item).strip()
            if not s:
                continue
            storey = json.loads(s)
            sname = storey.get("storey_name", "Default")
            elev = float(storey.get("elevation", 0.0))
            elems = storey.get("elements", [])
            parsed = [json.loads(e) if isinstance(e, str) else e for e in elems]
            storeys_out.append(
                {
                    "name": sname,
                    "elevation": elev,
                    "elements": parsed,
                }
            )
            total += len(parsed)

        project_json = {
            "ifc_version": _ifc_version,
            "project": {"name": _project_name, "author": _author},
            "unit": _unit,
            "site": {"name": "Site"},
            "buildings": [{"name": "Building", "storeys": storeys_out}],
        }

        out = "Built project JSON: {} elements across {} storey(s).".format(
            total, len(storeys_out)
        )
        json_out = json.dumps(project_json, separators=(",", ":"))

    except Exception as exc:
        out = "FAILED: {}".format(exc)

print(out)
# ---------- end ifckit_build_json ----------
ifckit_export_ifc = IfckitExportIFC()  # -> out, model_ready; inputs json_input: String, ifc_output: String, run_export: Boolean, run_preview: Boolean, mesh_quality: String, sticky_key: String
# ---------- ifckit_export_ifc: Python ----------
import sys as _sys
_src_dir = r'/Users/Mauc/L140-py-ifckit/grasshopper/src'
if _src_dir not in _sys.path:
    _sys.path.insert(0, _src_dir)
del _sys, _src_dir

import json
import ifckit_reload  # noqa: F401 — sets sys.path and reloads all of ifckit

from ifckit.json_build import build

import scriptcontext as sc

_quality    = mesh_quality if mesh_quality else "default"
_sticky_key = sticky_key   if sticky_key   else "ifckit_model"
_ver_key    = _sticky_key + "_version"

out         = ""
model_ready = sc.sticky.get(_ver_key, 0)  # expose current version even when idle

if not json_input:
    out = "ERROR: no JSON input."
elif not run_export and not run_preview:
    try:
        data = json.loads(json_input)
        total = sum(
            len(s.get("elements", []))
            for b in data.get("buildings", [])
            for s in b.get("storeys", [])
        )
        lines = [f"Model has {total} elements."]
        if ifc_output:
            lines.append(f"Set run_export=True to export to:\n  {ifc_output}")
        lines.append("Set run_preview=True to preview in Rhino.")
        out = "\n".join(lines)
    except json.JSONDecodeError as exc:
        out = f"ERROR: Invalid JSON: {exc}"
else:
    try:
        data  = json.loads(json_input)
        model = build(data)
        messages = []

        if run_export:
            if not ifc_output:
                messages.append("EXPORT SKIPPED: ifc_output is empty.")
            else:
                model.save(ifc_output)
                messages.append(f"Exported to:\n  {ifc_output}")

        if run_preview:
            count = model.preview_rhino(mesh_quality=_quality)
            messages.append(f"Previewing {count} elements in Rhino.")

        # Store model in sticky for drawing nodes.
        sc.sticky[_sticky_key] = model
        sc.sticky[_ver_key]    = sc.sticky.get(_ver_key, 0) + 1
        model_ready            = sc.sticky[_ver_key]
        messages.append(f"Model stored (version {model_ready}).")

        out = "\n".join(messages)

    except Exception as exc:
        import traceback
        out = f"FAILED: {exc}\n{traceback.format_exc()}"

print(out)
# ---------- end ifckit_export_ifc ----------
ifckit_beam = IfckitBeam()  # -> out, json_out; inputs line_curve: Curve, profile_pts: list of Point3d, profile_json: String, name: String
# ---------- ifckit_beam: Python ----------
import sys as _sys
_src_dir = r'/Users/Mauc/L140-py-ifckit/grasshopper/src'
if _src_dir not in _sys.path:
    _sys.path.insert(0, _src_dir)
del _sys, _src_dir

import json
import ifckit_reload  # noqa: F401 — sets sys.path and reloads all of ifckit

from ifckit import PendingBeam, Vec
from ifckit.profiles import Profile
import ifckit.rhinokit as rk
from ifckit.builders.beam_factory import PathType, classify_path


def _get_profile():
    """Get profile from profile_json (Profile.to_dict() format) or profile_pts."""
    if profile_json:
        try:
            data = json.loads(profile_json)
            if "profile_type" in data:
                return Profile.dispatch_from_dict(data)
        except Exception:
            pass

    if profile_pts:
        return rk.pts_to_vecs(profile_pts)

    return None


messages = []
json_outputs = []

if line_curve:
    line = rk.curve_to_line(line_curve)
    if not line:
        messages.append("ERR: invalid line curve")
    else:
        prof = _get_profile()
        if not prof:
            messages.append("ERR: no profile (provide profile_pts or profile_json)")
        else:
            path_type = classify_path(line)
            if path_type != PathType.SINGLE_LINE:
                messages.append(f"ERR: expected single line path, got {path_type}")
            else:
                try:
                    el_name = name or "Beam"
                    beam = PendingBeam(axis=line, profile=prof, name=el_name)
                    json_outputs.append(beam.to_json())
                    messages.append(f"OK  {el_name}")
                except Exception as exc:
                    messages.append(f"ERR {el_name}: {exc}")

elif not line_curve:
    messages.append("No line curve")

out = "\n".join(messages) if messages else "No beams processed."
print(out)
json_out = json_outputs if json_outputs else []
# ---------- end ifckit_beam ----------
ifckit_beam_any_path = IfckitBeamAnyPath()  # -> out, path_type, json_out; inputs path_curve: Curve, profile_pts: list of Point3d, profile_json: String, name: String
# ---------- ifckit_beam_any_path: Python ----------
import sys as _sys
_src_dir = r'/Users/Mauc/L140-py-ifckit/grasshopper/src'
if _src_dir not in _sys.path:
    _sys.path.insert(0, _src_dir)
del _sys, _src_dir

import math
import json
import ifckit_reload  # noqa: F401 — sets sys.path and reloads all of ifckit

from ifckit import PendingBeam, PendingRevolvedBeam, Vec
from ifckit.profiles import Profile
import ifckit.rhinokit as rk
from ifckit.builders.beam_factory import PathType, classify_path


def _get_profile():
    """Get profile from profile_json (Profile.to_dict() format) or profile_pts."""
    if profile_json:
        try:
            data = json.loads(profile_json)
            if "profile_type" in data:
                return Profile.dispatch_from_dict(data)
        except Exception:
            pass

    if profile_pts:
        return rk.pts_to_vecs(profile_pts)

    return None


messages = []
json_outputs = []

if path_curve:
    line = rk.curve_to_line(path_curve)
    if line:
        path = line
        detected_path_type = classify_path(path)
    else:
        arc = rk.arc_to_arc(path_curve)
        if arc:
            path = arc
            detected_path_type = classify_path(path)
        else:
            messages.append("ERR: invalid curve (not line or arc)")
            detected_path_type = "unknown"

    if detected_path_type in (PathType.SINGLE_LINE, PathType.SINGLE_ARC):
        prof = _get_profile()
        if not prof:
            messages.append("ERR: no profile (provide profile_pts or profile_json)")
        else:
            try:
                el_name = name or "Beam"

                if detected_path_type == PathType.SINGLE_LINE:
                    beam = PendingBeam(axis=path, profile=prof, name=el_name)
                    solid_type = "ExtrudedAreaSolid"
                else:
                    beam = PendingRevolvedBeam(arc=path, profile=prof, name=el_name)
                    solid_type = "RevolvedAreaSolid"
                    angle_deg = math.degrees(abs(path.angle))

                json_outputs.append(beam.to_json())
                if detected_path_type == PathType.SINGLE_LINE:
                    messages.append(f"OK  {el_name} ({solid_type})")
                else:
                    messages.append(f"OK  {el_name} ({solid_type}, {angle_deg:.0f}° arc)")
            except Exception as exc:
                messages.append(f"ERR {el_name}: {exc}")
    elif detected_path_type == PathType.MULTI_SEGMENT:
        messages.append("ERR: multi-segment path not yet implemented")
    elif detected_path_type == PathType.NON_PLANAR:
        messages.append("ERR: non-planar path not yet implemented")
    else:
        if not messages:
            messages.append("ERR: could not classify path")

elif not path_curve:
    messages.append("No path curve")

out = "\n".join(messages) if messages else "No beams processed."
print(out)
path_type = detected_path_type if 'detected_path_type' in dir() else ""
json_out = json_outputs if json_outputs else []
# ---------- end ifckit_beam_any_path ----------
ifckit_wall = IfckitWall()  # -> out, json_out; inputs base_curve: Curve, height: Double, thickness: Double, name: String
# ---------- ifckit_wall: Python ----------
import sys as _sys
_src_dir = r'/Users/Mauc/L140-py-ifckit/grasshopper/src'
if _src_dir not in _sys.path:
    _sys.path.insert(0, _src_dir)
del _sys, _src_dir

import json
import ifckit_reload  # noqa: F401 — sets sys.path and reloads all of ifckit
from ifckit import PendingWall, Plane, rhinokit as rk

messages = []
json_outputs = []

if base_curve:
    curves = base_curve if hasattr(base_curve, "__iter__") else [base_curve]

    for i, crv in enumerate(curves):
        if crv is None:
            continue
        el_name = f"{name or 'Wall'}-{i + 1}"
        try:
            footprint = rk.polyline_to_vecs(crv)
            wall = PendingWall(
                footprint=footprint,
                plane=Plane.world_xy(),
                height=float(height),
                name=el_name,
            )
            json_outputs.append(wall.to_json())
            messages.append(f"OK  {el_name}")
        except Exception as exc:
            messages.append(f"ERR {el_name}: {exc}")

out = "\n".join(messages) if messages else "No walls processed."
json_out = json_outputs if json_outputs else []
# ---------- end ifckit_wall ----------
ifckit_drawing = IfckitDrawing()  # -> out; inputs model_ready: Int32, drawing_name: String, run: Boolean, hlr_poly: Boolean, mesher_defl: Double, hatch_pattern: String, clear: Boolean, sticky_key: String, dest_plane: Plane
# ---------- ifckit_drawing: Python ----------
import sys as _sys
_src_dir = r'/Users/Mauc/L140-py-ifckit/grasshopper/src'
if _src_dir not in _sys.path:
    _sys.path.insert(0, _src_dir)
del _sys, _src_dir

import ifckit_reload  # noqa: F401 — sets sys.path and reloads all of ifckit

from ifckit.rhino_import import IfcSvgImporter

import scriptcontext as sc

# ---------------------------------------------------------------------------
# Resolve inputs
# ---------------------------------------------------------------------------
_sticky_key    = sticky_key    if sticky_key    else "ifckit_model"
_drawing_name  = drawing_name  if drawing_name  else ""
_hlr_poly      = hlr_poly      if hlr_poly is not None else True
_mesher_defl   = float(mesher_defl) if mesher_defl else None
_hatch_pattern = hatch_pattern if hatch_pattern else "Solid"
_clear         = clear         if clear is not None else True
_model_ready   = model_ready   if model_ready is not None else 0

# Destination plane — None means keep drawing on section plane.
_dest_plane = dest_plane if dest_plane is not None else None

out = ""

# ---------------------------------------------------------------------------
# Guards
# ---------------------------------------------------------------------------
if not _drawing_name:
    out = "Set drawing_name to the exact name of the drawing to generate."

elif not run:
    model = sc.sticky.get(_sticky_key)
    if model is None:
        out = (
            f"No model in sc.sticky[{_sticky_key!r}].\n"
            "Run the Export node first, then set run=True here."
        )
    else:
        lines = [
            f"Model ready (version {_model_ready}).",
            f"Drawing: {_drawing_name!r}",
        ]
        if _dest_plane is not None:
            lines.append(f"Destination plane: {_dest_plane.Origin}")
        lines.append("Set run=True to generate.")
        out = "\n".join(lines)

else:
    # -----------------------------------------------------------------------
    # Generate
    # -----------------------------------------------------------------------
    model = sc.sticky.get(_sticky_key)

    if model is None:
        out = (
            f"ERROR: no model found in sc.sticky[{_sticky_key!r}].\n"
            "Run the Export node first."
        )
    else:
        try:
            importer = IfcSvgImporter(hatch_pattern=_hatch_pattern)

            if _clear:
                removed = importer.clear_drawing(_drawing_name)
                clear_msg = f"Cleared {removed} existing objects."
            else:
                clear_msg = ""

            result = importer.import_model(
                model,
                hlr_poly=_hlr_poly,
                mesher_deflection=_mesher_defl,
                drawing_filter=_drawing_name,
                destination_plane=_dest_plane,
            )

            lines = [
                f"Drawing:  {_drawing_name!r}",
                f"Curves:   {result['curves']}",
                f"Hatches:  {result['hatches']}",
            ]
            if _dest_plane is not None:
                lines.append(f"Placed on destination plane: {_dest_plane.Origin}")
            if clear_msg:
                lines.append(clear_msg)
            out = "\n".join(lines)

        except Exception as exc:
            import traceback
            out = f"FAILED: {exc}\n{traceback.format_exc()}"

print(out)
# ---------- end ifckit_drawing ----------
ifckit_svg_curves = IfckitSVGCurves()  # -> out; inputs json_input: String, project_name: String, author: String, unit: String, run: Boolean, ifc_path: String, hlr_poly: Boolean, mesher_defl: Double
# ---------- ifckit_svg_curves: Python ----------
import sys as _sys
_src_dir = r'/Users/Mauc/L140-py-ifckit/grasshopper/src'
if _src_dir not in _sys.path:
    _sys.path.insert(0, _src_dir)
del _sys, _src_dir

import ifckit_reload  # noqa: F401 — sets sys.path and reloads all of ifckit

# ---------------------------------------------------------------------------
# Resolve inputs with sensible defaults
# ---------------------------------------------------------------------------
import json

_project_name  = project_name   if project_name   else "GH Project"
_author        = author         if author         else "GH"
_unit          = unit.upper()   if unit           else "MILLIMETRE"
_ifc_path      = ifc_path       if ifc_path       else ""
_hlr_poly      = hlr_poly       if hlr_poly is not None else True
_mesher_defl   = float(mesher_defl) if mesher_defl else None

out = ""

if not run:
    out = "Set run=True to import SVG curves into Rhino."

elif _ifc_path:
    # -----------------------------------------------------------------------
    # Direct IFC file import — bypass JSON build
    # -----------------------------------------------------------------------
    try:
        from ifckit.rhino_import import IfcSvgImporter

        importer = IfcSvgImporter()
        importer.clear()
        result = importer.import_file(
            _ifc_path,
            hlr_poly=_hlr_poly,
            mesher_deflection=_mesher_defl,
        )
        out = (
            f"Imported from file:\n  {_ifc_path}\n"
            f"Curves:  {result['curves']}\n"
            f"Hatches: {result['hatches']}"
        )
    except Exception as exc:
        import traceback
        out = f"FAILED: {exc}\n{traceback.format_exc()}"

elif json_input:
    # -----------------------------------------------------------------------
    # Build IFC from JSON then import
    # -----------------------------------------------------------------------
    try:
        from ifckit.json_build import build

        data = json.loads(json_input)

        project_json = {
            "ifc_version": "IFC4",
            "project": {"name": _project_name, "author": _author},
            "unit": _unit,
            "site": {"name": "Site"},
            "buildings": [
                {
                    "name": "Building",
                    "storeys": [
                        {
                            "name": storey_name,
                            "elevation": 0.0,
                            "elements": [
                                json.loads(elem_json)
                                if isinstance(elem_json, str)
                                else elem_json
                                for elem_json in elements
                            ],
                        }
                        for storey_name, elements in data.get("storeys", {}).items()
                    ],
                }
            ],
        }

        model = build(project_json)
        result = model.preview_rhino_curves(
            clear=True,
            hlr_poly=_hlr_poly,
            mesher_deflection=_mesher_defl,
        )
        out = (
            f"Curves:  {result['curves']}\n"
            f"Hatches: {result['hatches']}"
        )

    except Exception as exc:
        import traceback
        out = f"FAILED: {exc}\n{traceback.format_exc()}"

else:
    out = "ERROR: provide json_input or ifc_path."

print(out)
# ---------- end ifckit_svg_curves ----------
ifckit_profile = IfckitProfile()  # -> out, json_out; inputs profile_type: String, height: Double, width: Double, web_thickness: Double, flange_thickness: Double, radius: Double, wall_thickness: Double, steel_name: String, unit: String, name: String
# ---------- ifckit_profile: Python ----------
import sys as _sys
_src_dir = r'/Users/Mauc/L140-py-ifckit/grasshopper/src'
if _src_dir not in _sys.path:
    _sys.path.insert(0, _src_dir)
del _sys, _src_dir

import json
import ifckit_reload  # noqa: F401 — sets sys.path and reloads all of ifckit

from ifckit.profiles import (
    IBeamProfile, LBeamProfile,
    RectangleProfile, CircleProfile, HollowCircleProfile,
    SteelProfile,
)
from ifckit.schema import LengthUnit

_pt = (profile_type or "").strip().lower()
messages = []
json_out = ""

try:
    profile = None

    if _pt == "i":
        h  = float(height or 0)
        w  = float(width or 0)
        wt = float(web_thickness or 0)
        ft = float(flange_thickness or 0)
        if h <= 0 or w <= 0 or wt <= 0 or ft <= 0:
            raise ValueError("height, width, web_thickness, flange_thickness all required for I-beam")
        profile = IBeamProfile(height=h, width=w, web_thickness=wt, flange_thickness=ft, name=name or "I-Profile")

    elif _pt == "l":
        h  = float(height or 0)
        w  = float(width or 0)
        ft = float(flange_thickness or 0)
        if h <= 0 or w <= 0 or ft <= 0:
            raise ValueError("height, width, flange_thickness all required for L-beam")
        profile = LBeamProfile(height=h, width=w, flange_thickness=ft, name=name or "L-Profile")

    elif _pt == "rect":
        w = float(width or 0)
        h = float(height or 0)
        if w <= 0 or h <= 0:
            raise ValueError("width and height required for rect")
        profile = RectangleProfile(width=w, height=h, name=name or "Rect-Profile")

    elif _pt == "circle":
        r = float(radius or 0)
        if r <= 0:
            raise ValueError("radius required for circle")
        profile = CircleProfile(radius=r, name=name or "Circle-Profile")

    elif _pt == "hollow_circle":
        r  = float(radius or 0)
        wt = float(wall_thickness or 0)
        if r <= 0 or wt <= 0:
            raise ValueError("radius and wall_thickness required for hollow_circle")
        profile = HollowCircleProfile(radius=r, wall_thickness=wt, name=name or "HollowCircle-Profile")

    elif _pt == "steel":
        sname = (steel_name or "").strip()
        if not sname:
            raise ValueError("steel_name required for steel profile")
        u_str = (unit or "m").strip().lower()
        lu = LengthUnit.MILLIMETRE if u_str == "mm" else LengthUnit.METRE
        profile = SteelProfile.from_name(sname, unit=lu)
        if name:
            profile.name = name

    else:
        raise ValueError(
            "profile_type must be one of: 'I', 'L', 'rect', 'circle', 'hollow_circle', 'steel'"
        )

    json_out = json.dumps(profile.to_dict())
    messages.append(f"OK  {profile.name or _pt}")

except Exception as exc:
    messages.append(f"ERR: {exc}")

out = "\n".join(messages) if messages else "No profile processed."
# ---------- end ifckit_profile ----------
ifckit_spaces = IfckitSpaces()  # -> out; inputs ifc_path: String, run: Boolean, layer_root: String, hatch_pattern: String, import_fp: Boolean, import_hatch: Boolean, import_ann: Boolean, import_mesh: Boolean, mesh_quality: String, clear: Boolean
# ---------- ifckit_spaces: Python ----------
import sys as _sys
_src_dir = r'/Users/Mauc/L140-py-ifckit/grasshopper/src'
if _src_dir not in _sys.path:
    _sys.path.insert(0, _src_dir)
del _sys, _src_dir

import ifckit_reload  # noqa: F401 — sets sys.path and reloads all of ifckit

from ifckit.rhino_import import IfcSpaceImporter

import scriptcontext as sc

# ---------------------------------------------------------------------------
# Resolve inputs
# ---------------------------------------------------------------------------
_ifc_path      = ifc_path      if ifc_path      else ""
_layer_root    = layer_root    if layer_root    else "IFC-Spaces"
_hatch_pattern = hatch_pattern if hatch_pattern else "Solid"
_import_fp     = import_fp     if import_fp  is not None else True
_import_hatch  = import_hatch  if import_hatch is not None else True
_import_ann    = import_ann    if import_ann  is not None else True
_import_mesh   = import_mesh   if import_mesh is not None else False
_mesh_quality  = mesh_quality  if mesh_quality else "default"
_clear         = clear         if clear is not None else True

out = ""

# ---------------------------------------------------------------------------
# Guards
# ---------------------------------------------------------------------------
if not _ifc_path:
    out = "Set ifc_path to the absolute path of the IFC file."

elif not run:
    out = (
        f"IFC file: {_ifc_path}\n"
        f"Layer root: {_layer_root!r}\n"
        f"Import: footprint={_import_fp}, hatch={_import_hatch}, "
        f"annotation={_import_ann}, mesh={_import_mesh}\n"
        "Set run=True to import."
    )

else:
    try:
        importer = IfcSpaceImporter(
            layer_root=_layer_root,
            hatch_pattern=_hatch_pattern,
            import_footprint=_import_fp,
            import_hatch=_import_hatch,
            import_annotation=_import_ann,
            import_mesh=_import_mesh,
            mesh_quality=_mesh_quality,
        )

        if _clear:
            removed = importer.clear()
            clear_msg = f"Cleared {removed} existing objects."
        else:
            clear_msg = ""

        result = importer.import_file(_ifc_path)

        lines = [
            f"Spaces:      {result['spaces']}",
            f"Footprints:  {result['footprints']}",
            f"Hatches:     {result['hatches']}",
            f"Annotations: {result['annotations']}",
            f"Meshes:      {result['meshes']}",
        ]
        if clear_msg:
            lines.append(clear_msg)
        out = "\n".join(lines)

    except Exception as exc:
        import traceback
        out = f"FAILED: {exc}\n{traceback.format_exc()}"

print(out)
# ---------- end ifckit_spaces ----------
